# Grasshopper definition rhinomanager_masterfile.gh (Grasshopper 1.0.7)
# plug-ins: MeshEdit Components, horsterCameraControl, FlexHopper, Virtual Robot, Websocket_Communicator

go = BooleanToggle(True)

# ----
# addresses
panel = Panel("http://127.0.0.1:")
panel_2 = Panel("""/action_reach/
/action_sim/
/fh_run/
/fh_reset/""")
pid = CSharpScript(prefix=panel, port_prefix="4", suffixes=panel_2)  # -> out, pid, port, A, B, C, D; inputs prefix: String, port_prefix: String, suffixes: list of String
# ---------- pid: C# ----------
    string _pid = System.Diagnostics.Process.GetCurrentProcess().Id.ToString();
    pid = _pid;

    string _port = _pid;
    for(int l = _port.Length; l < 5; l++)
      _port = _port.Insert(0, port_prefix);

    port = _port;

    A = prefix + _port + suffixes[0];
    B = prefix + _port + suffixes[1];
    C = prefix + _port + suffixes[2];
    D = prefix + _port + suffixes[3];
# ---------- end pid ----------

httpin = HttpInput(Start=go, Prefix=pid.C)  # -> Keys, Values, ListenerObject
entwine = Entwine(Branch00=httpin.Keys, Branch01=httpin.Values, Branch02=httpin.ListenerObject, FlattenInputs=True)
panel_3 = Panel("http://127.0.0.1:<pid>/fh_run/")
dam = DataDam(DataA=entwine, BufferDelay=2500000, BufferMode=2)
bang = ExplodeTree(Data=dam)  # -> Branch0, Branch1, Branch2
keysearch = KeyValueSearch(Keys=bang.Branch0, Values=bang.Branch1, Search="run")
bool = Boolean(keysearch)
httpout = HttpOutput(HttpListener=bang.Branch2)

httpin_2 = HttpInput(Start=go, Prefix=pid.D)  # -> Keys, Values, ListenerObject
entwine_2 = Entwine(Branch00=httpin_2.Keys, Branch01=httpin_2.Values, Branch02=httpin_2.ListenerObject, FlattenInputs=True)
panel_4 = Panel("http://127.0.0.1:<pid>/fh_reset/")
dam_2 = DataDam(DataA=entwine_2, BufferDelay=2500000, BufferMode=2)
bang_2 = ExplodeTree(Data=dam_2)  # -> Branch0, Branch1, Branch2
keysearch_2 = KeyValueSearch(Keys=bang_2.Branch0, Values=bang_2.Branch1, Search="reset")
bool_2 = Boolean(keysearch_2)
httpout_2 = HttpOutput(HttpListener=bang_2.Branch2)

manually_trigger = Button()
show_box_numbers = BooleanToggle(False)
reset_flexhopper = Button()
flexhopper_unlocked = BooleanToggle(True)
manual_tcp = BooleanToggle(False)
and = GateAnd(A=bool, B=flexhopper_unlocked)
or = GateOr(A=bool_2, B=reset_flexhopper)

# ----
# Extruder
geo = Geometry([<mesh referenced from the Rhino model>, <point referenced from the Rhino model>])  # disabled
item = ListItem(List=geo, Index=0, Wrap=True)  # -> Item, Item1; disabled
xz = XZPlane(Origin=Point(0, 0, 0))  # disabled
pflip = FlipPlane(Plane=xz, ReverseX=False, ReverseY=False, SwapAxes=True)  # disabled
rotate = Rotate(Geometry=pflip, Angle=1.570796327, Plane=pflip)  # -> Geometry, Transform; disabled
pl_origin = PlaneOrigin(Base=rotate.Geometry, Origin=item.Item1)  # disabled
end_effector = DefineEndEffector(Geometry=item.Item, TCPFrame=pl_origin, MountingFrame=PlaneXY(0, 0, 0))  # disabled

# ----
# Effector
pt = ConstructPoint(XCoordinate=0, YCoordinate=-230, ZCoordinate=0)
mesh = Mesh(<mesh referenced from the Rhino model>)
xz_2 = XZPlane(Origin=pt)
xz_3 = XZPlane(Origin=Point(0, 0, 0))
end_effector_2 = DefineEndEffector(Geometry=mesh, TCPFrame=xz_2, MountingFrame=xz_3)

# ----
# ROBOT
ur10 = PredefinedUniversalRobotUR10(BaseFrame=PlaneXY(0, 0, 0), EndEffectorOptional=end_effector_2)

mesh_2 = Mesh(<mesh referenced from the Rhino model>)
box = Box({Plane=PlaneXY(0, 0, 0), X=Domain(-397.5, 397.5), Y=Domain(-1045.999999, 149.0000006), Z=Domain(-930, 0)})
medges = MeshEdges(Mesh=mesh_2)  # -> NakedEdges, InteriorEdges, NonManifoldEdges
preview = CustomPreview(Geometry=[medges.InteriorEdges, box], Material=ColourSwatch(SwatchColor=RGBA(153, 153, 153, 80)))
panel_5 = Panel("""16000
1024
16000
16000
16000
2048
2048
2048
2048""")

stability_scale_factor = Slider(0.015, range=0..1)
opts = FlexSolverOptions(
    TimeStep="0.24",
    SubSteps="10",
    NumIterations="5",
    SceneMode=Slider(1, range=0..2),
    FixedNumberOfIteration=-1,
    MemoryRequirements=panel_5,
    StabilityScale=stability_scale_factor)

panel_6 = Panel("C:\Users\Benjamin\OneDrive - felbrich.com\Work\01 Academic\04 Robotic Reinforcement Learning\02 Virtual Experiments\block_stacking.xml")
params = FlexParametersFromXmlFile(FilePath=panel_6)

mesh_3 = Mesh(<mesh referenced from the Rhino model>)
velocity_threshold = Slider(60, range=0..200)
box_planes = TelepathyOUT()

httpin_3 = HttpInput(Start=go, Prefix=pid.B)  # -> Keys, Values, ListenerObject
entwine_3 = Entwine(Branch00=httpin_3.Keys, Branch01=httpin_3.Values, Branch02=httpin_3.ListenerObject, FlattenInputs=True)
panel_7 = Panel("http://127.0.0.1:<pid>/action_sim/")
dam_3 = DataDam(DataA=entwine_3, BufferDelay=2500000, BufferMode=2)
bang_3 = ExplodeTree(Data=dam_3)  # -> Branch0, Branch1, Branch2
panel_8 = Panel("""session
act_id
A0
A1
A2
A3
A4
A5""")
keysearch_3 = KeyValueSearch(Keys=bang_3.Branch0, Values=bang_3.Branch1, Search=panel_8)
split = SplitList(List=keysearch_3, Index=1)  # -> ListA, ListB
session_name = Text(split.ListA)
data = Data(bang_3.Branch2)

split_2 = SplitList(List=split.ListB, Index=1)  # -> ListA, ListB

panel_9 = Panel("http://127.0.0.1:<pid>/action_reach/")
httpin_4 = HttpInput(Start=go, Prefix=pid.A)  # -> Keys, Values, ListenerObject
entwine_4 = Entwine(Branch00=httpin_4.Keys, Branch01=httpin_4.Values, Branch02=httpin_4.ListenerObject, FlattenInputs=True)
dam_4 = DataDam(DataA=entwine_4, BufferDelay=2500000, BufferMode=2)
bang_4 = ExplodeTree(Data=dam_4)  # -> Branch0, Branch1, Branch2
keysearch_4 = KeyValueSearch(Keys=bang_4.Branch0, Values=bang_4.Branch1, Search="render")
panel_10 = Panel("""session
act_id
A0
A1
A2
A3
A4
A5""")
gate = StreamGate(Stream=dam_4, Gate=keysearch_4)  # -> Target0, Target1
bang_5 = ExplodeTree(Data=gate.Target0)  # -> Branch0, Branch1, Branch2
keysearch_5 = KeyValueSearch(Keys=bang_5.Branch0, Values=bang_5.Branch1, Search=panel_10)
split_3 = SplitList(List=keysearch_5, Index=1)  # -> ListA, ListB
split_4 = SplitList(List=split_3.ListB, Index=1)  # -> ListA, ListB
session_name_2 = Text(split_3.ListA)
txt = Text(split_4.ListA)
num = Number(split_4.ListB)
data_2 = Data(bang_5.Branch2)

# ----
# DOCUMENTATION
bang_6 = ExplodeTree(Data=gate.Target1)  # -> Branch0, Branch1, Branch2
panel_11 = Panel("""session
play
round""")
c_script = CSharpScript(MINIMISE_GH=go)  # -> out, A; inputs MINIMISE_GH: Boolean
# ---------- c_script: C# ----------
    if(MINIMISE_GH)
      Grasshopper.Instances.DocumentEditor.WindowState = System.Windows.Forms.FormWindowState.Minimized;
# ---------- end c_script ----------
keysearch_6 = KeyValueSearch(Keys=bang_6.Branch0, Values=bang_6.Branch1, Search=panel_11)
num_2 = Number("50")
pt_2 = ConstructPoint(XCoordinate="4000", YCoordinate="-5000", ZCoordinate="1500")
pt_3 = ConstructPoint(XCoordinate="0", YCoordinate="-300", ZCoordinate="250")
item_2 = ListItem(List=keysearch_6, Index=0, Wrap=True)  # -> Item, Item1, Item2
setcam = SetCamera(CameraLocation=pt_2, TargetLocation=pt_3, LensLength=num_2, Activate=keysearch_4)
c_script_2 = CSharpScript(
    go=keysearch_4,
    vp_name="main",
    session_name=item_2.Item,
    play=item_2.Item1,
    round=item_2.Item2,
    width=Slider(1080, range=0..10000),
    height=Slider(1080, range=0..10000),
    listener=bang_6.Branch2)  # -> out, A, L; inputs go: Boolean, vp_name: String, session_name: String, play: Int32, round: Int32, width: Int32, height: Int32
# ---------- c_script_2: C# ----------
    if(go)
    {
      System.DateTime dt = System.DateTime.Now;
      if(dt.Subtract(old_dt).Duration().TotalMilliseconds > min_interval_ms)
      {
        System.Drawing.Bitmap _bmp = null;
        foreach(Rhino.Display.RhinoView rv in Rhino.RhinoDoc.ActiveDoc.Views)
        {
          if(rv.MainViewport.Name == vp_name){
            _bmp = rv.CaptureToBitmap(new System.Drawing.Size(width, height));
          }
        }
        if(_bmp == null)
        {
          A = "ERROR";
          throw new Exception("Couldn't take screenshot");

        }
        var t = System.DateTime.Now.ToString("yyddMM-HHmmss");
        string rp = Rhino.RhinoDoc.ActiveDoc.Path;
        var dir = rp.Substring(0, rp.LastIndexOf(@"\") + 1) + "screenshots\\" + session_name;
        if (!System.IO.Directory.Exists(dir))
        {
          System.IO.Directory.CreateDirectory(dir);
        }
        var f = t + "_" + play + "_" + round;
        var p = dir + "\\" + f;
        if(System.IO.File.Exists(p + ".jpg"))
          p += "_2";
        _bmp.Save(p + ".jpg");
        A = session_name + "\\" + f + ".jpg";
        old_dt = System.DateTime.Now;
      }
      L = listener;
    }
# ---------- c_script_2: C# additional code ----------
  System.DateTime old_dt = System.DateTime.Now;
  int min_interval_ms = 500;
# ---------- end c_script_2 ----------

# ----
# START UP PROCEDURE
# 
# 0. make sure that:
# TRACK_BOX_PLANES: true
# OPEN_GRIPPER: true
# MANUALLY BLOCK REQUEST: false
# MANUAL TCP: false
# 
# 1. start ROS host & deepbuilder launch
# 2. reset FlexHopper
# 3. Skip FlexHopper: False
# 4. Connect to host
# 5. start Learner on host
or_2 = GateOr(A=keysearch_4, B=show_box_numbers)
httpout_3 = HttpOutput(Response=c_script_2.A, HttpListener=c_script_2.L)

# ----
# Manual TCP
crv = Curve([<curve referenced from the Rhino model> x2])
cluster = Cluster(C=crv)

c_script_3 = CSharpScript(tcp=cluster)  # -> out, A; inputs tcp: String
# ---------- c_script_3: C# ----------
    using (var md5 = System.Security.Cryptography.MD5Cng.Create())
    {
      byte[] hash = md5.ComputeHash(System.Text.Encoding.Default.GetBytes(tcp + DateTime.Now.Millisecond.ToString()));
      Guid result = new Guid(hash);
      A = result.ToString().Substring(0, 8);
    }
# ---------- end c_script_3 ----------

panel_12 = Panel(c_script_3.A)

entwine_5 = Entwine(Branch00=cluster, Branch01=c_script_3.A, FlattenInputs=True)  # -> simplify(Result)
filter = StreamFilter(Gate=manual_tcp, Stream0=num, Stream1=cluster)

act_id = Text(split_2.ListA)
axis_vals = Number(split_2.ListB)

filter_2 = StreamFilter(Gate=go, Stream1=axis_vals)
filter_3 = StreamFilter(Gate=manual_tcp, Stream0=filter_2, Stream1=cluster)
condexp = ConditionalExpiryDam(ExpiryCondition=4, InputData=filter_3)
deg = Degrees(Radians=condexp)
null = NullItem(Item=condexp)  # -> NullFlags, InvalidFlags, Description
ma = MassAddition(Input=null.NullFlags)  # -> Result, PartialResults
robot_fk = RobotForwardKinematics(Robot=ur10, AxisValues=deg, useColorPreview=False)  # -> PoseGeometry, TCPFrame, AxisFrames
bool_3 = Boolean(invert(ma.Result))
condexp_2 = ConditionalExpiryDam(ExpiryCondition=bool_3, InputData=robot_fk.TCPFrame)

robo_tcp = Plane(condexp_2)

# ----
# SIMULATION BODIES
approx_mesh_edge_length = Slider(20, range=1..200)
number_slider = Slider(40, range=0..200)
number_slider_2 = Slider(20, range=0..200)
division = Division(A=number_slider, B=approx_mesh_edge_length)
division_2 = Division(A=number_slider_2, B=approx_mesh_edge_length)
box_2 = CenterBox(Base=robo_tcp, X=number_slider, Y=number_slider, Z=number_slider_2)
mbox = MeshBox(Base=box_2, XCount=expr("x*2", division), YCount=expr("x*2", division), ZCount=expr("x*3", division_2))
weldvertices = MeshWeldVertices(Mesh=mbox, Tolerance=0.01)  # -> RuntimeMessage, Mesh
mesh_4 = Mesh(weldvertices.Mesh)

# ----
# VISUALISATION BODIES
addition = Addition(A=number_slider_2, B=approx_mesh_edge_length)
addition_2 = Addition(A=number_slider, B=approx_mesh_edge_length)
box_3 = CenterBox(Base=robo_tcp, X=addition_2, Y=addition_2, Z=addition)
mbox_2 = MeshBox(Base=box_3, XCount=1, YCount=1, ZCount=1)
weldvertices_2 = MeshWeldVertices(Mesh=mbox_2, Tolerance=0.01)  # -> RuntimeMessage, Mesh
mesh_5 = Mesh(weldvertices_2.Mesh)

# ----
# RECORD BOX PLANES
pln = Plane(robo_tcp)

c_script_4 = CSharpScript(reset=or, simMesh=mesh_4, visBox=mesh_5, tcp=pln)  # -> flatten(GInd), flatten(currentSimMesh), visBoxes, boxPlanes; inputs reset: Boolean, simMesh: Mesh, visBox: Mesh, tcp: Plane
# ---------- c_script_4: C# ----------
    if(reset)
    {
      b = new List<Mesh>();
      p = new List<Plane>();
      justReset = true;
    }
    else if(!justReset){
      b.Add(visBox);
      p.Add(tcp);
      visBoxes = b;
      boxPlanes = p;
      currentSimMesh = simMesh;
      GInd = b.Count;
    }
    else{
      justReset = false;}
# ---------- c_script_4: C# additional code ----------
  bool justReset = false;
  List<Mesh> b = new List<Mesh>();
  List<Plane> p = new List<Plane>();
# ---------- end c_script_4 ----------

clean = CleanTree(RemoveNulls=True, RemoveInvalid=True, RemoveEmpty=True, Tree=c_script_4.GInd)
clean_2 = CleanTree(RemoveNulls=True, RemoveInvalid=True, RemoveEmpty=True, Tree=c_script_4.currentSimMesh)
clean_3 = CleanTree(RemoveNulls=True, RemoveInvalid=True, RemoveEmpty=True, Tree=c_script_4.boxPlanes)

pt_4 = ConstructPoint(XCoordinate=0, YCoordinate=0, ZCoordinate=0)
particles = ParticlesFromPoints(Points=pt_4)
rigid = RigidFromMesh(RigidBodyMesh=clean_2, Velocities=Vector(0, 0, 0), Mass=1, Stiffness=1, GroupIndex=clean)
scene = FlexScene(Particles=flatten(particles), RigidBodies=flatten(rigid))

# ----
# ROBO COLLIDERS
deg_2 = Degrees(Radians=filter)
condexp_3 = ConditionalExpiryDam(ExpiryCondition=2, InputData=deg_2)
robot_fk_2 = RobotForwardKinematics(Robot=ur10, AxisValues=deg_2, useColorPreview=False)  # -> PoseGeometry, TCPFrame, AxisFrames
robo_color = TelepathyOUT()
filter_4 = StreamFilter(
    Gate=robo_color,
    Stream0=ColourSwatch(SwatchColor=RGBA(96, 105, 107, 34)),
    Stream1=ColourSwatch(SwatchColor=RGBA(214, 0, 0, 55)))

robot_fk_3 = RobotForwardKinematics(Robot=ur10, AxisValues=condexp_3, useColorPreview=False)  # -> PoseGeometry, TCPFrame, AxisFrames
preview_2 = CustomPreview(Geometry=robot_fk_3.PoseGeometry, Material=ColourSwatch(SwatchColor=RGB(153, 153, 153)))

default_collision_mesh = Mesh(flatten([<mesh referenced from the Rhino model> x7]))
pln_2 = Plane(flatten([PlaneXY(0, 0, 41.3), Plane(origin=(0, -86, 128), x=(0, 0, 1), y=(-1, 0, 0)), Plane(origin=(-612.7, -107.9, 128), x=(-1, 0, 0), y=(0, 0, -1)), PlaneYZ(-1184.3, -109.9, 128), Plane(origin=(-1184.3, -163.9, 66.3), x=(0, -1, 0), y=(0, 0, 1)), PlaneXZ(-1184.3, -256.1, 12.3)]))

item_3 = ListItem(List=default_collision_mesh, Index=0, Wrap=True)  # -> Item, Item1, Item2, Item3, Item4, Item5, Item6
entwine_6 = Entwine(
    Branch00=item_3.Item,
    Branch01=item_3.Item1,
    Branch02=item_3.Item2,
    Branch03=item_3.Item3,
    Branch04=item_3.Item4,
    Branch05=[item_3.Item5, item_3.Item6],
    FlattenInputs=True)  # -> simplify(Result)
orient = Orient(Geometry=entwine_6, Source=simplify(graft(pln_2)), Target=simplify(graft(robot_fk_2.AxisFrames)))  # -> flatten(Geometry), Transform

collision_mesh = Mesh(orient.Geometry)

demesh = DeconstructMesh(Mesh=collision_mesh)  # -> flatten(Vertices), Faces, Colours, Normals
pdecon = Deconstruct(Point=demesh.Vertices)  # -> XComponent, YComponent, ZComponent
smaller = SmallerThan(FirstNumber=pdecon.ZComponent, SecondNumber=0)  # -> SmallerThan, OrEqualTo
ma_2 = MassAddition(Input=smaller.SmallerThan)  # -> Result, PartialResults

minc = MeshInclusion(Mesh=mesh_2, Point=demesh.Vertices, Strict=False)
split_5 = SplitList(List=reverse(collision_mesh), Index=3)  # -> ListA, ListB

pt_5 = ConstructPoint(XCoordinate=0, YCoordinate=0, ZCoordinate=-930)
condexp_4 = ConditionalExpiryDam(ExpiryCondition=2, InputData=[collision_mesh, mesh_3])
xy = XYPlane(Origin=pt_5)
collgeometry = FlexCollisionGeometry(CollisionPlanes=flatten(xy), CollisionMeshes=flatten(condexp_4))

quad = Quadrangulate(Mesh=collision_mesh, Angle=0.03490658504, Ratio=0.875)  # -> Mesh, Count
lng = ListLength(List=demesh.Vertices)
ma_3 = MassAddition(Input=minc)  # -> Result, PartialResults
medges_2 = MeshEdges(Mesh=quad.Mesh)  # -> flatten(NakedEdges), flatten(InteriorEdges), NonManifoldEdges
colom = CollisionOneMany(Collider=split_5.ListA, Obstacles=split_5.ListB)  # -> Collision, Index

preview_3 = CustomPreview(Geometry=[medges_2.InteriorEdges, medges_2.NakedEdges], Material=filter_4)

equals = Equality(FirstNumber=lng, SecondNumber=ma_3.Result)  # -> Equality, Inequality
ma_4 = MassAddition(Input=colom.Collision)  # -> Result, PartialResults
bool_4 = Boolean(equals.Inequality)

# ----
# ENV COLLISION
env_collision = Boolean(bool_4)
panel_13 = Panel(env_collision)

# ----
# SELF COLLISION
self_collision = Boolean(ma_4.Result)
panel_14 = Panel(self_collision)

flex = FlexEngine(
    FlexParams=params,
    FlexCollisionGeometry=collgeometry,
    FlexScene=flatten(scene),
    FlexSolverOptions=opts,
    Reset=or,
    Go=and)  # -> FlexObject, Information

or_3 = GateOr(A=env_collision, B=self_collision)
robo_color_2 = TelepathyIN(Robo_color=or_3)

# ----
# BOX VISUALISATION
# visualize
transform = GetRigidTranformations(FlexObject=flex.FlexObject)  # -> Translations, RotationVectors, RotationAngles, Transformations
transform_2 = Transform(Geometry=c_script_4.visBoxes, Transform=transform.Transformations)
clean_4 = CleanTree(RemoveNulls=True, RemoveInvalid=True, RemoveEmpty=False, Tree=transform_2)

state_parse = CSharpScript(
    session=session_name_2,
    render_file=c_script_2.A,
    action_id=txt,
    env_collision=env_collision,
    self_collision=self_collision,
    fastest_box=0,
    highest_box=0,
    current_height=Slider(1, range=0..1),
    box_planes=box_planes,
    Reference="C:\Windows\Microsoft.NET\Framework64\v4.0.30319\System.Web.Extensions.dll")  # -> A; inputs session: String, render_file: String, action_id: String, env_collision: Boolean, self_collision: Boolean, fastest_box: Int32, highest_box: Int32, current_height: Double, box_planes: list of Plane
# ---------- state_parse: C# ----------
    var o = new ArgObject();
    o.session = session;
    o.render_file = render_file;
    o.state.action_id = action_id;
    o.state.env_collision = (bool) env_collision;
    o.state.self_collision = (bool) self_collision;
    o.state.current_height = (float) current_height;
    o.state.fastest_box = fastest_box;
    o.state.highest_box = highest_box;

    o.state.box_poses = new pose[box_planes.Count];
    for(int i = 0; i < box_planes.Count; i++)
    {
      o.state.box_poses[i] = FromPlane(box_planes[i]);
    }

    A = ToJSON(o);
# ---------- state_parse: C# additional code ----------
  public pose FromPlane(Plane p)
  {
    pose t = new pose();
    t.position = new position_();

    t.position.x = p.OriginX;
    t.position.y = p.OriginY;
    t.position.z = p.OriginZ;

    var q = Quaternion.Rotation(Plane.WorldXY, p);

    t.orientation = new orientation_();

    t.orientation.w = q.A;
    t.orientation.x = q.B;
    t.orientation.y = q.C;
    t.orientation.z = q.D;

    return t;
  }

  public class ArgObject
  {
    //these names have to match the msg signature. the other names are not so important
    public class state_{
      public string action_id;
      public bool env_collision;
      public bool self_collision;
      public float current_height;
      public int highest_box;
      public int fastest_box;
      public pose[] box_poses;
    }

    public state_ state = new state_();
    public string session = "___";
    public string render_file = "___";
  }



  public struct pose
  {
    public position_ position;
    public orientation_ orientation;
  }

  public struct position_
  {
    public double x;
    public double y;
    public double z;
  }

  public struct orientation_
  {
    public double x;
    public double y;
    public double z;
    public double w;
  }

  public static object ToJSON(object obj)
  {
    var json = new System.Web.Script.Serialization.JavaScriptSerializer().Serialize(obj);
    return json;
  }
# ---------- end state_parse ----------

# ----
# BOX NUMBERS
number_slider_3 = Slider(34, range=1..200)
filter_5 = StreamFilter(Gate=or_2, Stream1=transform_2)
facen = FaceNormals(Mesh=filter_5)  # -> Centers, Normals
lng_2 = ListLength(List=transform_2)
pl = PlaneNormal(Origin=facen.Centers, ZAxis=facen.Normals)  # -> simplify(Plane)
series = Series(Start=1, Step=1, Count=lng_2)
int = Integer(series)
tag = TextTag3D(
    Location=pl,
    Text=simplify(graft(int)),
    Size=number_slider_3,
    Colour=ColourSwatch(SwatchColor=RGB(89, 178, 255)),
    Justification=5)

# ----
# BOX PLANES
transform_3 = Transform(Geometry=clean_3, Transform=transform.Transformations)
clean_5 = CleanTree(RemoveNulls=True, RemoveInvalid=True, RemoveEmpty=False, Tree=transform_3)  # -> flatten(Tree)
preview_4 = CustomPreview(Geometry=clean_5, Material=ColourSwatch(SwatchColor=RGBA(18, 38, 56, 89)))  # disabled

httpout_4 = HttpOutput(Response=state_parse, HttpListener=data_2)

medges_3 = MeshEdges(Mesh=clean_4)  # -> NakedEdges, InteriorEdges, NonManifoldEdges

# ----
# This is fucked up but yeah
condexp_5 = ConditionalExpiryDam(ExpiryCondition=3, InputData=clean_5)
condexp_6 = ConditionalExpiryDam(ExpiryCondition=3, InputData=condexp_5)
box_planes_2 = TelepathyIN(Box_planes=condexp_6)

preview_5 = CustomPreview(Geometry=flatten([medges_3.NakedEdges, medges_3.InteriorEdges]), Material=ColourSwatch(SwatchColor=RGBA(23, 20, 17, 72)))
preview_6 = CustomPreview(Geometry=flatten(clean_4), Material=ColourSwatch(SwatchColor=RGBA(255, 184, 184, 129)))
deplane = DeconstructPlane(Plane=condexp_6)  # -> Origin, XAxis, YAxis, ZAxis; disabled

# ----
# only expire every nth
number_slider_4 = Slider(5, range=1..30)
c_script_5 = CSharpScript(Flex=flex.FlexObject, mod=number_slider_4)  # -> Flex, isMod; inputs mod: Int32, reset: Boolean
# ---------- c_script_5: C# ----------
    if(reset)
    {
      i = 0;
    }

    _Flex = Flex;
    isMod = i % mod == 0;
    i++;
# ---------- c_script_5: C# additional code ----------
  int i = 0;
# ---------- end c_script_5 ----------

entwine_7 = Entwine(Branch00=c_script_5.Flex, Branch01=condexp_6, FlattenInputs=True)  # -> simplify(Result)

condexp_7 = ConditionalExpiryDam(ExpiryCondition=c_script_5.isMod, InputData=entwine_7)
bang_7 = ExplodeTree(Data=condexp_7)  # -> Branch0, Branch1, Branch2
# SIMULATION STATE
allparts = GetAllParticles(FlexObject=bang_7.Branch0, N=1)  # -> Points, Vector

eval_sim_state = CSharpScript(reset=or, fh_running=and, pts=allparts.Points, vec=allparts.Vector, speed_threshold=velocity_threshold)  # -> out, simState, isSlow, highestBox, highestHeight, highestParticle, fastestBox, fastestVector, fastestSpeed, fastestParticle; inputs reset: Boolean, fh_running: Boolean, pts: tree of Point3d, vec: tree of Vector3d, speed_threshold: Double
# ---------- eval_sim_state: C# ----------
    sim_status = -1; //undefined
    if(!fh_running)
    {
      sim_status = 0; //fh off
    }
    else
    {
      if(previous_sim_status == 0)
      {
        sim_status = 1; //just started
      }
      else
      {
        if(pts.BranchCount < 2)
        {
          sim_status = 2;
        }
        else
        {
          FindFastest(pts, vec, speed_threshold, out IsSlow, out FastestBox, out FastestVector, out FastestSpeed, out FastestParticle);
          FindHighest(pts, out HighestBox, out HighestHeight, out HighestParticle);

          if(!IsSlow)
            sim_status = 3;
          else
          {
            if(!previous_IsSlow)
              sim_status = 4;
            else
              sim_status = 5;
          }
        }
      }
    }

    _simState = previous_sim_status = sim_status;
    _isSlow = previous_IsSlow = IsSlow;
    _highestBox = HighestBox;
    _highestHeight = HighestHeight;
    _highestParticle = HighestParticle;
    _fastestBox = FastestBox;
    _fastestVector = FastestVector;
    _fastestSpeed = FastestSpeed;
    _fastestParticle = FastestParticle;
# ---------- eval_sim_state: C# additional code ----------
  int sim_status = -1;
  //-1 - undefined
  //0 - simulation not running
  //1 - just started
  //2 - fh_running but without any boxes
  //3 - system_moving
  //4 - boxes just came to halt
  //5 - simulation running but boxes are at rest
  int previous_sim_status = -1;
  bool previous_IsSlow = true;

  //all outputs
  int HighestBox = -1;
  double HighestHeight = 0.0;
  Point3d HighestParticle = new Point3d();
  int FastestBox = -1;
  Vector3d FastestVector = new Vector3d();
  double FastestSpeed = 0.0;
  Point3d FastestParticle = new Point3d();
  bool IsSlow = true;


  //when performed for the first time per iteration, the result is stored in boxes_are_slow, so it doesn't have to be recomputed in one iteration
  void FindFastest(DataTree<Point3d> pts, DataTree<Vector3d> vec, double threshold, out bool isSlow, out int fastestBox,
    out Vector3d fastestVector, out double highestSpeed, out Point3d fastestParticle)
  {
    highestSpeed = 0.0;
    fastestBox = 0;
    fastestParticle = new Point3d();
    fastestVector = new Vector3d();

    for(int i = 1; i < vec.BranchCount; i++)
    {
      double avg_speed = 0.0;
      for(int j = 0; j < vec.Branch(i).Count; j++)
      {
        avg_speed += vec.Branch(i)[j].SquareLength * (1.0/vec.Branch(i).Count);
        
      }
      if(avg_speed > highestSpeed)
      {
        highestSpeed = avg_speed;
        fastestBox = i - 1; //to account for the place holder particle
        fastestParticle = pts.Branch(i)[0];
        fastestVector = vec.Branch(i)[0];
      }
    }
    highestSpeed = Math.Sqrt(highestSpeed);
    isSlow = highestSpeed < threshold;
  }

  void FindHighest(DataTree<Point3d> pts, out int highestBox, out double highestHeight, out Point3d highestParticle)
  {
    highestHeight = 0.0;
    highestBox = 0;
    highestParticle = new Point3d();

    for(int i = 1; i < pts.BranchCount; i++)
    {
      double avg_height = 0.0;
      for(int j = 0; j < pts.Branch(i).Count; j++)
      {
        avg_height += pts.Branch(i)[j].Z * (1.0 / pts.Branch(i).Count);
      }

      if(avg_height > highestHeight)
      {
        highestHeight = avg_height;
        highestBox = i - 1;//to account for the place holder particle
        highestParticle = pts.Branch(i)[0];
      }
    }
  }
# ---------- end eval_sim_state ----------
panel_15 = Panel(eval_sim_state.simState)
panel_16 = Panel(eval_sim_state.highestHeight)
item_4 = ListItem(List=reverse(condexp_6), Index=0, Wrap=True)
c_script_6 = CSharpScript(planeA=condexp_2, planeB=item_4)  # -> out, D; inputs planeA: Plane, planeB: Plane
# ---------- c_script_6: C# ----------
    //var t = Transform.PlaneToPlane(planeA, planeB);
    var q1 = Quaternion.Rotation(Plane.WorldXY, planeA);
    var q2 = Quaternion.Rotation(Plane.WorldXY, planeB);

    var c = 2.0 * Math.Acos((q1.A * q2.A + q1.B * q2.B + q1.C * q2.C + q1.D * q2.D) % 1.0);
    D = Math.Min(c, Math.PI * 2 - c);
# ---------- end c_script_6 ----------

# ----
# DECIDE OVER NEXT REQUEST
number_slider_5 = Slider(3, range=1..10)
request_next = CSharpScript(fh_running=and, simState=eval_sim_state.simState, manually_trigger=manually_trigger, threshold=number_slider_5)  # -> out, request, state_history; inputs fh_running: Boolean, simState: Int32, manually_block: Boolean, manually_trigger: Boolean, threshold: Int32
# ---------- request_next: C# ----------
    //it works the following:
    //this component returns true if the following sequence is found in the record of sim_state:
    //[4, 5, 5, 5, ... 5] (5 must occur threshold times)
    //this sequence indicates that a box was dropped and the simulation came to rest afterwards for some predefined time

    if(simState != 4 && simState != 5 || !fh_running)
    {
      request = false;
      previous_states = new List<int>();
      SetStatePattern(threshold);
    }
    else
    {
      previous_states.Add(simState);
      SetStatePattern(threshold);

      while(previous_states.Count > threshold + 1)
      {
        previous_states.RemoveAt(0);
      }

      request = true;
      for(int i = 0; i < previous_states.Count; i++)
      {
        if(previous_states[i] != state_pattern_to_look_for[i])
          request = false;
      }
      if(previous_states.Count != state_pattern_to_look_for.Count)
        request = false;

      if(manually_trigger)
        request = true;
      if(manually_block)
        request = false;

    }

    _request = request;
    _state_history = previous_states;
# ---------- request_next: C# additional code ----------
  List<int> previous_states = new List<int>();
  List<int> state_pattern_to_look_for = new List<int>();
  bool request = false;

  void SetStatePattern(int threshold)
  {
    state_pattern_to_look_for = new List<int>();
    state_pattern_to_look_for.Add(5);
    //state_pattern_to_look_for.Add(5);
    for(int i = 0; i < threshold; i++)
      state_pattern_to_look_for.Add(5);
  }
# ---------- end request_next ----------

join = TextJoin(Text=request_next.state_history, Join=" ")

# ----
# highest
item_5 = ListItem(List=clean_4, Index=eval_sim_state.highestBox, Wrap=True)
preview_7 = CustomPreview(Geometry=item_5, Material=ColourSwatch(SwatchColor=RGBA(255, 200, 0, 196)))

# ----
# fastest
swatch = ColourSwatch(SwatchColor=RGBA(0, 255, 229, 193))
item_6 = ListItem(List=clean_4, Index=eval_sim_state.fastestBox, Wrap=True)
preview_8 = CustomPreview(Geometry=item_6, Material=swatch)

# ----
# fastest vector
vdis = VectorDisplay(Anchor=eval_sim_state.fastestParticle, Vector=eval_sim_state.fastestVector)  # disabled

# ----
# State Parse
state_parse_2 = CSharpScript(
    session=session_name,
    action_id=act_id,
    env_collision=env_collision,
    self_collision=self_collision,
    fastest_box=eval_sim_state.fastestBox,
    highest_box=eval_sim_state.highestBox,
    current_height=eval_sim_state.highestHeight,
    last_tcp=condexp_2,
    box_planes=bang_7.Branch1,
    displacement=c_script_6.D,
    Reference="C:\Windows\Microsoft.NET\Framework64\v4.0.30319\System.Web.Extensions.dll")  # -> A; inputs session: String, action_id: String, env_collision: Boolean, self_collision: Boolean, fastest_box: Int32, highest_box: Int32, current_height: Double, last_tcp: Plane, box_planes: list of Plane, displacement: Double
# ---------- state_parse_2: C# ----------
    var o = new ArgObject();
    o.session = session;
    o.displacement = displacement;
    o.state.action_id = action_id;
    o.state.env_collision = env_collision;
    o.state.self_collision = (bool) self_collision;
    o.state.current_height = (float) current_height;
    o.state.fastest_box = fastest_box;
    o.state.highest_box = highest_box;
    o.state.last_tcp = FromPlane(last_tcp);


    o.state.box_poses = new pose[box_planes.Count];
    for(int i = 0; i < box_planes.Count; i++)
    {
      o.state.box_poses[i] = FromPlane(box_planes[i]);
      //if(i == box_planes.Count - 1)

    }

    A = ToJSON(o);
# ---------- state_parse_2: C# additional code ----------
  public pose FromPlane(Plane p)
  {
    pose t = new pose();
    t.position = new position_();

    t.position.x = p.OriginX;
    t.position.y = p.OriginY;
    t.position.z = p.OriginZ;

    var q = Quaternion.Rotation(Plane.WorldXY, p);

    t.orientation = new orientation_();

    t.orientation.w = q.A;
    t.orientation.x = q.B;
    t.orientation.y = q.C;
    t.orientation.z = q.D;

    return t;
  }

  public class ArgObject
  {
    //these names have to match the msg signature. the other names are not so important
    public class state_{
      public string action_id;
      public bool env_collision;
      public bool self_collision;
      public float current_height;
      public int highest_box;
      public int fastest_box;
      public pose[] box_poses;
      public pose last_tcp;
    }

    public double displacement = 0.0;
    public state_ state = new state_();
    public string session = "___";
  }



  public struct pose
  {
    public position_ position;
    public orientation_ orientation;
  }

  public struct position_
  {
    public double x;
    public double y;
    public double z;
  }

  public struct orientation_
  {
    public double x;
    public double y;
    public double z;
    public double w;
  }

  public static object ToJSON(object obj)
  {
    var json = new System.Web.Script.Serialization.JavaScriptSerializer().Serialize(obj);
    return json;
  }
# ---------- end state_parse_2 ----------

entwine_8 = Entwine(Branch00=state_parse_2, Branch01=data, FlattenInputs=True)
condexp_8 = ConditionalExpiryDam(ExpiryCondition=request_next.request, InputData=entwine_8)
bang_8 = ExplodeTree(Data=condexp_8)  # -> Branch0, Branch1

httpout_5 = HttpOutput(Response=bang_8.Branch0, HttpListener=bang_8.Branch1)

# ----
# WRITE STATE
panel_17 = Panel("""0: not running
1: just started
2: running w/o boxes
3: system moving
: boxes just came to halt
: running but boxes at rest
-1 - undefined""")
division_3 = Division(A=eval_sim_state.simState, B=7)  # disabled
# //-1 - undefined
# //0 - simulation not running
# //1 - just started
# //2 - fh_running but without any boxes
# //3 - box dropping
# //4 - system_moving
# //5 - boxes just came to halt
# //6 - simulation running but boxes keep resting
pt_6 = Point(Point(-213.4140347, -40.98704818, 0))  # disabled
xy_2 = XYPlane(Origin=pt_6)
hsl = ColourHSL(Alpha=1, Hue=division_3, Saturation=1, Luminance=0.5)
rotate_2 = Rotate(Geometry=xy_2, Angle=4.71238898, Plane=xy_2)  # -> Geometry, Transform
item_7 = ListItem(List=panel_17, Index=eval_sim_state.simState, Wrap=True)

concat = Concatenate(FragmentA=join, FragmentB=item_7)
filter_6 = StreamFilter(Gate=request_next.request, Stream0=hsl, Stream1=ColourSwatch(SwatchColor=RGB(255, 0, 0)))
filter_7 = StreamFilter(Gate=request_next.request, Stream0=concat, Stream1="___|||  STATE SENT  |||___")

tag_2 = TextTag3D(Location=rotate_2.Geometry, Text=filter_7, Size="80", Colour=filter_6, Justification=5)

# ----
# box x,y std
avr = Average(Input=deplane.Origin)
subtraction = Subtraction(A=deplane.Origin, B=avr)
sqr = Square(Value=subtraction)
avr_2 = Average(Input=sqr)
sqrt = SquareRoot(Value=avr_2)
pdecon_2 = Deconstruct(Point=sqrt)  # -> XComponent, YComponent, ZComponent
sqr_2 = Square(Value=pdecon_2.YComponent)
sqr_3 = Square(Value=pdecon_2.XComponent)
addition_3 = Addition(A=sqr_3, B=sqr_2)
sqrt_2 = SquareRoot(Value=addition_3)

c_script_7 = CSharpScript(x=avr)  # -> out, A; inputs x: Plane
# ---------- c_script_7: C# ----------
    x.OriginZ = 1.0;
    A = x;
# ---------- end c_script_7 ----------

cir = Circle(Plane=c_script_7.A, Radius=sqrt_2)
preview_9 = CustomPreview(Geometry=cir, Material=ColourSwatch(SwatchColor=RGB(150, 120, 120)))

boundary = BoundarySurfaces(Edges=cir)
preview_10 = CustomPreview(Geometry=boundary, Material=ColourSwatch(SwatchColor=RGBA(150, 150, 150, 15)))

# ==== cluster Cluster
C = ClusterInput()
end = EndPoints(Curve=C)  # -> Start, End
item = ListItem(List=end.End, Index=0, Wrap=True)  # -> Item, Item1
item_2 = ListItem(List=end.Start, Index=0, Wrap=True)
pl_3pt = Plane3Pt(PointA=item_2, PointB=item.Item, PointC=item.Item1)
pl = ClusterOutput(pl_3pt)
